# Grasshopper definition 03__01_001_Triangle.gh (Grasshopper 1.0.7)
# plug-ins: RhinoCodePluginGH

# ----
# Oscillation Algorithm
# The oscillation algorithm can be use to animate
# any geometry that is driven by a number sliders.
# Simply swap out the number sliders at the
# multiplication node in the oscillation script.
trigger = Trigger(Interval=10, TimerInterval=10, Target=data_recorder)  # disabled
panel = Panel("1")  # disabled
data_recorder = DataRecorder(panel, DataLimit=-10, RecordData=False)  # disabled
number_slider = Slider(288, range=0..1000)  # disabled
list_length = ListLength(List=data_recorder)  # disabled
division = Division(A=list_length, B=number_slider)  # disabled
cosine = Cosine(Value=division)  # disabled
sine = Sine(Value=division)  # disabled
# 2nd gpt-4 Text Prompt
# Great, now make the script much more complex model
# with NUMPY python library.
# Be sure to incorporate the previous code logic.
# ensure that this script produces 3d geometry as
# well for Data visualization purposes.
panel_2 = Panel([sine, cosine])  # disabled
multiplication = Multiplication(A=cosine)  # disabled
multiplication_2 = Multiplication(A=sine)  # disabled

triangle = Script()  # -> out, a, b, c, d, e; inputs a: list of Double, b: list of Double; disabled
# ---------- triangle: Python ----------
import Rhino.Geometry as rg

def create_quad(v1, v2, v3, v4):
    """Create a mesh quad from four vertices."""
    mesh = rg.Mesh()
    mesh.Vertices.Add(v1)
    mesh.Vertices.Add(v2)
    mesh.Vertices.Add(v3)
    mesh.Vertices.Add(v4)
    mesh.Faces.AddFace(0, 1, 2, 3)
    return mesh

def triangle_prism(vertex1, vertex2, vertex3, height):
    # Construct the base triangle
    base_triangle = rg.Polyline([vertex1, vertex2, vertex3, vertex1]).ToNurbsCurve()

    # Area of the triangle
    triangle_area = rg.AreaMassProperties.Compute(base_triangle).Area

    # Construct the triangular prism
    move_vector = rg.Vector3d(0, 0, height)
    top_vertex1 = vertex1 + move_vector
    top_vertex2 = vertex2 + move_vector
    top_vertex3 = vertex3 + move_vector

    faces = [
        create_quad(vertex1, vertex2, vertex3, vertex1),  # Base
        create_quad(vertex1, vertex2, top_vertex2, top_vertex1),  # Side 1
        create_quad(vertex2, vertex3, top_vertex3, top_vertex2),  # Side 2
        create_quad(vertex1, vertex3, top_vertex3, top_vertex1)   # Side 3
    ]
    
    prism_mesh = rg.Mesh()
    for face in faces:
        prism_mesh.Append(face)

    # Volume of the prism
    prism_volume = triangle_area * height

    # Surface area of the prism
    surface_area = rg.AreaMassProperties.Compute(prism_mesh).Area

    return base_triangle, prism_mesh, triangle_area, prism_volume, surface_area

# Example: Creating a triangular prism
v1 = rg.Point3d(0, 0, 0)
v2 = rg.Point3d(4, 0, 0)
v3 = rg.Point3d(2, 3, 0)
h = 5

base_triangle, prism_mesh, tri_area, prism_vol, surf_area = triangle_prism(v1, v2, v3, h)

# Outputs
a = base_triangle
b = prism_mesh
c = tri_area
d = prism_vol
e = surf_area
# ---------- end triangle ----------
# Visualize Mathematics
# with Python in Grasshopper
# at Wickerson Studios
# 003 AREA, VOLUME AND SURFACE AREA
# 3.1 AREA:
# 03_003_001_triangle
# BASIC SCRIPT
# gpt-4 Text Prompt
# Create a geometric 3D model with
# 
# MATHEMATICS
# AREA, VOULUME AND SURFACE AREA
# 
# to create a 3D model specifically about
# 
# TRIANGLE
# 
# 
# in python 3 code for the python 3 script
# node in grasshopper for Rhino8WIP using the
# Rhino Common API to create some geometry as well.
# 
# Output the parts of the model in different
# variable outputs in the python 3 node in
# grasshopper.
panel_3 = Panel(triangle.out)  # disabled
geometry = Geometry(triangle.a)  # disabled
# PARAMETRIC SCRIPT
geometry_2 = Geometry(triangle.b)  # disabled
entwine = Entwine(
    Branch00=geometry,
    Branch01=geometry_2,
    Branch02=triangle.c,
    Branch03=triangle.d,
    Branch04=triangle.e,
    FlattenInputs=True)  # disabled
triangle_2 = Script(num_prisms=Slider(100, range=0..100), pts=Slider(100, range=0..100), h=Slider(10, range=0..10))  # -> out, a, b, c, d; inputs num_prisms: Int32, pts: Double, h: Double
# ---------- triangle_2: Python ----------
import Rhino.Geometry as rg
import numpy as np

def triangle_prism(vertex1, vertex2, vertex3, height):
    move_vector = rg.Vector3d(0, 0, height)
    top_vertex1 = vertex1 + move_vector
    top_vertex2 = vertex2 + move_vector
    top_vertex3 = vertex3 + move_vector

    base_triangle_curve = rg.Polyline([vertex1, vertex2, vertex3, vertex1]).ToNurbsCurve()
    top_triangle_curve = rg.Polyline([top_vertex1, top_vertex2, top_vertex3, top_vertex1]).ToNurbsCurve()
    
    base_triangle_brep, = rg.Brep.CreatePlanarBreps(base_triangle_curve)
    top_triangle_brep, = rg.Brep.CreatePlanarBreps(top_triangle_curve)

    side1, = rg.Brep.CreateFromLoft([rg.LineCurve(vertex1, top_vertex1), rg.LineCurve(vertex2, top_vertex2)], rg.Point3d.Unset, rg.Point3d.Unset, rg.LoftType.Normal, False)
    side2, = rg.Brep.CreateFromLoft([rg.LineCurve(vertex2, top_vertex2), rg.LineCurve(vertex3, top_vertex3)], rg.Point3d.Unset, rg.Point3d.Unset, rg.LoftType.Normal, False)
    side3, = rg.Brep.CreateFromLoft([rg.LineCurve(vertex1, top_vertex1), rg.LineCurve(vertex3, top_vertex3)], rg.Point3d.Unset, rg.Point3d.Unset, rg.LoftType.Normal, False)

    brep_parts = [base_triangle_brep, top_triangle_brep, side1, side2, side3]
    final_brep = rg.Brep.JoinBreps(brep_parts, 0.01)[0]

    triangle_area = rg.AreaMassProperties.Compute(base_triangle_brep).Area
    prism_volume = rg.VolumeMassProperties.Compute(final_brep).Volume
    surface_area = rg.AreaMassProperties.Compute(final_brep).Area

    return final_brep, triangle_area, prism_volume, surface_area

#num_prisms = 10
prism_breps = []
areas = []
volumes = []
surface_areas = []

for _ in range(num_prisms):
    points = np.random.rand(3, 3) * pts
    height = np.random.rand() * h
    v1 = rg.Point3d(points[0, 0], points[0, 1], points[0, 2])
    v2 = rg.Point3d(points[1, 0], points[1, 1], points[1, 2])
    v3 = rg.Point3d(points[2, 0], points[2, 1], points[2, 2])
    
    prism_brep, tri_area, prism_vol, surf_area = triangle_prism(v1, v2, v3, height)
    
    prism_breps.append(prism_brep)
    areas.append(tri_area)
    volumes.append(prism_vol)
    surface_areas.append(surf_area)

a = prism_breps
b = areas
c = volumes
d = surface_areas
# ---------- end triangle_2 ----------
panel_4 = Panel(triangle_2.out)
geometry_3 = Geometry(triangle_2.a)
# gpt-4 Initial Response
# Alright, let's create a simple 3D model of a
# triangular prism in Python using the Rhino
# Common API for the Grasshopper node in
# Rhino. The triangular prism will be our way to tie
# the concepts of area (for the triangular base),
# volume, and surface area together with the
# triangle theme.
panel_5 = Panel(entwine)  # disabled
entwine_2 = Entwine(Branch00=geometry_3, Branch01=triangle_2.b, Branch02=triangle_2.c, Branch03=triangle_2.d, FlattenInputs=True)
# gpt-4 Initial Response
# I understand, let's modify the script to create the
#  triangular prisms using NURBS surfaces. For
# this, we'll utilize the Brep.CreateFromLoft
# method for the sides, and the
# Brep.CreatePlanarBreps method for the top and
#  bottom triangles. Here's the revised script:
panel_6 = Panel(entwine_2)
