# Grasshopper definition 03__01_002_Rectangle.gh (Grasshopper 1.0.7)
# plug-ins: RhinoCodePluginGH

# ----
# Oscillation Algorithm
# The oscillation algorithm can be use to animate
# any geometry that is driven by a number sliders.
# Simply swap out the number sliders at the
# multiplication node in the oscillation script.
trigger = Trigger(Interval=10, TimerInterval=10, Target=data_recorder)  # disabled
panel = Panel("1")  # disabled
data_recorder = DataRecorder(panel, DataLimit=-10, RecordData=False)  # disabled
number_slider = Slider(288, range=0..1000)  # disabled
list_length = ListLength(List=data_recorder)  # disabled
division = Division(A=list_length, B=number_slider)  # disabled
cosine = Cosine(Value=division)  # disabled
sine = Sine(Value=division)  # disabled
# Great, now make the script much more complex model
# with NUMPY python library.
# Be sure to incorporate the previous code logic.
# ensure that this script produces 3d geometry as
# well for Data visualization purposes.
panel_2 = Panel([sine, cosine])  # disabled
multiplication = Multiplication(A=cosine)  # disabled
multiplication_2 = Multiplication(A=sine)  # disabled

# ----
# BASIC SCRIPT
# PARAMETRIC SCRIPT
number_slider_2 = Slider(100, range=0..100)
# 2nd gpt-4 Text Prompt
rectangle = Script()  # -> out, a, b, c, d, e; inputs a: list of Double, b: list of Double; disabled
# ---------- rectangle: Python ----------
import Rhino.Geometry as rg

def CreateRectangularPrism(length, width, height):
    # Define two corner points for the box
    pt1 = rg.Point3d(0, 0, 0)
    pt2 = rg.Point3d(length, width, height)
    
    # Create a bounding box using the two corner points
    bounding_box = rg.BoundingBox(pt1, pt2)
    box = rg.Brep.CreateFromBox(bounding_box)
    
    return box

def ComputeSurfaceArea(length, width, height):
    # Surface area = 2lw + 2lh + 2wh
    return 2 * (length * width + length * height + width * height)

def ComputeVolume(length, width, height):
    # Volume = lwh
    return length * width * height

length = 10  # Example length
width = 5   # Example width
height = 7  # Example height

box = CreateRectangularPrism(length, width, height)
surface_area = ComputeSurfaceArea(length, width, height)
volume = ComputeVolume(length, width, height)

# Outputs
a = box
b = surface_area
c = volume
# ---------- end rectangle ----------
geometry = Geometry(rectangle.a)  # disabled
# Visualize Mathematics
# with Python in Grasshopper
# at Wickerson Studios
# 003 AREA, VOLUME AND SURFACE AREA
# 3.1 AREA:
# 03_01_002_rectangle
# gpt-4 Text Prompt
# Create a geometric 3D model with
# 
# MATHEMATICS
# AREA, VOULUME AND SURFACE AREA
# 
# to create a 3D model specifically about
# 
# RECTANGLE
# 
# 
# in python 3 code for the python 3 script
# node in grasshopper for Rhino8WIP using the
# Rhino Common API to create some geometry as well.
# 
# Output the parts of the model in different
# variable outputs in the python 3 node in
# grasshopper.
panel_3 = Panel(rectangle.out)  # disabled
entwine = Entwine(Branch00=geometry, Branch01=rectangle.b, Branch02=rectangle.c, FlattenInputs=True)  # disabled
rectangle_2 = Script(num=number_slider_2, len=Slider(16.87, range=0..100), wid=Slider(22.51, range=0..100), hei=Slider(68.79, range=0..100))  # -> out, a, b, c, d, e; inputs num: Int32, len: list of Double, wid: Double, hei: Double
# ---------- rectangle_2: Python ----------
import Rhino.Geometry as rg
import numpy as np

def CreateRectangularPrism(length, width, height, position):
    # Define two corner points for the box at the given position
    pt1 = rg.Point3d(position[0], position[1], position[2])
    pt2 = rg.Point3d(position[0] + length, position[1] + width, position[2] + height)
    
    # Create a bounding box using the two corner points
    bounding_box = rg.BoundingBox(pt1, pt2)
    box = rg.Brep.CreateFromBox(bounding_box)
    
    return box

def ComputeSurfaceArea(length, width, height):
    # Surface area = 2lw + 2lh + 2wh
    return 2 * (length * width + length * height + width * height)

def ComputeVolume(length, width, height):
    # Volume = lwh
    return length * width * height

# Generate random values for lengths, widths, heights and positions
num_boxes = num
lengths = np.random.randint(1, _len, num_boxes)
widths = np.random.randint(1, _wid, num_boxes)
heights = np.random.randint(1, _hei, num_boxes)
positions = np.random.randint(0, 100, (num_boxes, 3)).tolist()

boxes = []
surface_areas = []
volumes = []

for i in range(num_boxes):
    length = int(lengths[i])
    width = int(widths[i])
    height = int(heights[i])
    position = [int(coord) for coord in positions[i]]
    
    box = CreateRectangularPrism(length, width, height, position)
    surface_area = ComputeSurfaceArea(length, width, height)
    volume = ComputeVolume(length, width, height)
    
    boxes.append(box)
    surface_areas.append(surface_area)
    volumes.append(volume)

# Outputs
a = boxes
b = surface_areas
c = volumes
# ---------- end rectangle_2 ----------
# gpt-4 Initial Response
# reating a 3D model based on a rectangle would
# yield a rectangular prism (also known as a box).
# If you want to compute the area, volume, and
# surface area and also want to create the
# geometry using the Rhino Common API in
# Grasshopper, here's a basic Python script:
panel_4 = Panel(entwine)  # disabled
panel_5 = Panel(rectangle_2.out)
geometry_2 = Geometry(rectangle_2.a)
entwine_2 = Entwine(Branch00=geometry_2, Branch01=rectangle_2.b, Branch02=rectangle_2.c, FlattenInputs=True)
# gpt-4 Initial Response
# To incorporate NumPy into the workflow and
# make the script more complex for data
# visualization purposes, let's:
# 
# Generate multiple boxes based on a NumPy
# random array for lengths, widths, and heights.
# Display these boxes at different positions in 3D
# space.
panel_6 = Panel(entwine_2)
