# Grasshopper definition 03__01_004_Parallelogram.gh (Grasshopper 1.0.7)
# plug-ins: RhinoCodePluginGH

# ----
# Oscillation Algorithm
# The oscillation algorithm can be use to animate
# any geometry that is driven by a number sliders.
# Simply swap out the number sliders at the
# multiplication node in the oscillation script.
trigger = Trigger(Interval=10, TimerInterval=10, Target=data_recorder)  # disabled
panel = Panel("1")  # disabled
data_recorder = DataRecorder(panel, DataLimit=-10, RecordData=False)  # disabled
number_slider = Slider(288, range=0..1000)  # disabled
list_length = ListLength(List=data_recorder)  # disabled
division = Division(A=list_length, B=number_slider)  # disabled
cosine = Cosine(Value=division)  # disabled
sine = Sine(Value=division)  # disabled
panel_2 = Panel([sine, cosine])  # disabled
multiplication = Multiplication(A=cosine)  # disabled
multiplication_2 = Multiplication(A=sine)  # disabled

# ----
# PARAMETRIC SCRIPT
# Great, now make the script much more complex model
# with NUMPY python library.
# Be sure to incorporate the previous code logic.
# ensure that this script produces 3d geometry as
# well for Data visualization purposes.
parallelogram = Script()  # -> out, a, b, c; inputs a: list of Double, b: list of Double
# ---------- parallelogram: Python ----------
import Rhino.Geometry as rg
import numpy as np

def CreateRectangularPrism(length, width, height, position):
    pt1 = rg.Point3d(position[0], position[1], position[2])
    pt2 = rg.Point3d(position[0] + length, position[1] + width, position[2] + height)
    bounding_box = rg.BoundingBox(pt1, pt2)
    box = rg.Brep.CreateFromBox(bounding_box)
    return box

def CreateSphere(radius, position):
    center = rg.Point3d(position[0], position[1], position[2])
    sphere = rg.Sphere(center, radius)
    return rg.Brep.CreateFromSphere(sphere)

def CreateParallelogram(base_point, dir1, dir2):
    pt1 = base_point
    pt2 = base_point + dir1
    pt3 = base_point + dir1 + dir2
    pt4 = base_point + dir2
    plg = rg.Polyline([pt1, pt2, pt3, pt4, pt1])
    return plg.ToNurbsCurve()

def ComputeVolumeOfSphere(radius):
    return (4/3) * np.pi * (radius**3)

# Generate random values for lengths, widths, heights, radii, and positions
num_geometries = 100
lengths = np.random.randint(1, 20, num_geometries)
widths = np.random.randint(1, 20, num_geometries)
heights = np.random.randint(1, 20, num_geometries)
radii = np.random.randint(1, 10, num_geometries)
x_positions = np.linspace(0, 100, num_geometries)
y_positions = 50 + 40 * np.sin(x_positions / 10)
z_positions = 50 + 40 * np.cos(x_positions / 10)

geometries = []
volumes = []
colors = []

for i in range(num_geometries):
    position = rg.Point3d(int(x_positions[i]), int(y_positions[i]), int(z_positions[i]))
    
    if i % 3 == 0:
        length = int(lengths[i])
        width = int(widths[i])
        height = int(heights[i])
        geom = CreateRectangularPrism(length, width, height, position)
        volume = length * width * height
    elif i % 3 == 1:
        radius = int(radii[i])
        geom = CreateSphere(radius, position)
        volume = ComputeVolumeOfSphere(radius)
    else:
        dir1 = rg.Vector3d(int(lengths[i]), int(widths[i]), 0)
        dir2 = rg.Vector3d(int(widths[i]), -int(lengths[i]), int(heights[i]))
        geom = CreateParallelogram(position, dir1, dir2)
        volume = 0  # Parallelograms in this case are 2D, so no volume
    
    # Color based on volume
    if volume < 500:
        color = [255, 0, 0]  # Red for smaller volumes
    elif volume < 1000:
        color = [0, 255, 0]  # Green for medium volumes
    else:
        color = [0, 0, 255]  # Blue for larger volumes
    
    geometries.append(geom)
    volumes.append(volume)
    colors.append(color)

# Outputs
a = geometries
b = volumes
c = colors
# ---------- end parallelogram ----------
# Create a geometric 3D model with
# 
# MATHEMATICS
# AREA, VOULUME AND SURFACE AREA
# 
# to create a 3D model specifically about
# 
# PARALLELOGRAM
# 
# 
# in python 3 code for the python 3 script
# node in grasshopper for Rhino8WIP using the
# Rhino Common API to create some geometry as well.
# 
# Output the parts of the model in different
# variable outputs in the python 3 node in
# grasshopper.
parallelogram_2 = Script()  # -> out, base, top, side1, side2, side3, side4; inputs a: list of Double, b: list of Double; disabled
# ---------- parallelogram_2: Python ----------
import Rhino.Geometry as rg

def create_parallelepiped(O, a, b, c):
    """
    Create a parallelepiped using origin and three vectors.
    
    Parameters:
    - O: origin point
    - a, b, c: vectors originating from O which define the parallelepiped edges.
    """

    # Define the corners of the parallelepiped
    P0 = O
    P1 = O + a
    P2 = O + b
    P3 = O + c
    P4 = O + a + b
    P5 = O + b + c
    P6 = O + a + c
    P7 = O + a + b + c
    
    # Construct the faces of the parallelepiped
    faces = [
        rg.NurbsSurface.CreateFromCorners(P0, P1, P4, P2),  # Base
        rg.NurbsSurface.CreateFromCorners(P3, P6, P7, P5),  # Top
        rg.NurbsSurface.CreateFromCorners(P0, P1, P6, P3),  # Side 1
        rg.NurbsSurface.CreateFromCorners(P1, P4, P7, P6),  # Side 2
        rg.NurbsSurface.CreateFromCorners(P4, P2, P5, P7),  # Side 3
        rg.NurbsSurface.CreateFromCorners(P2, P0, P3, P5)   # Side 4
    ]

    return faces

# Define the origin and vectors for your parallelepiped
O = rg.Point3d(0, 0, 0)
a = rg.Vector3d(5, 0, 0)  # Vector along X-direction
b = rg.Vector3d(0, 10, 0)  # Vector along Y-direction
c = rg.Vector3d(0, 0, 15)  # Vector along Z-direction

parallelepiped = create_parallelepiped(O, a, b, c)

# Output for Grasshopper
base = parallelepiped[0]
top = parallelepiped[1]
side1 = parallelepiped[2]
side2 = parallelepiped[3]
side3 = parallelepiped[4]
side4 = parallelepiped[5]
# ---------- end parallelogram_2 ----------
panel_3 = Panel(parallelogram.out)
geometry = Geometry(parallelogram.a)
# Visualize Mathematics
# with Python in Grasshopper
# at Wickerson Studios
# 003 AREA, VOLUME AND SURFACE AREA
# 3.1 AREA:
# 03_01_004_parallelogram
# BASIC SCRIPT
# gpt-4 Text Prompt
panel_4 = Panel(parallelogram_2.out)  # disabled
geometry_2 = Geometry(parallelogram_2.base)  # disabled
geometry_3 = Geometry(parallelogram_2.top)  # disabled
geometry_4 = Geometry(parallelogram_2.side1)  # disabled
geometry_5 = Geometry(parallelogram_2.side2)  # disabled
geometry_6 = Geometry(parallelogram_2.side3)  # disabled
# 2nd gpt-4 Text Prompt
geometry_7 = Geometry(parallelogram_2.side4)  # disabled
entwine = Entwine(Branch00=geometry, Branch01=parallelogram.b, Branch02=parallelogram.c, FlattenInputs=True)
entwine_2 = Entwine(
    Branch00=geometry_2,
    Branch01=geometry_3,
    Branch02=geometry_4,
    Branch03=geometry_5,
    Branch04=geometry_6,
    Branch05=geometry_7,
    FlattenInputs=True)  # disabled
# gpt-4 Initial Response
# lright, let's expand upon the previous model and
# make it more complex:
# 
# Instead of boxes, we'll create a field of random-
# sized boxes and spheres.
# We'll also vary the placement using a sinusoidal
# pattern to make the visualization more
# interesting.
# Lastly, we'll color the geometry based on its
# volume to provide a visualization cue.
panel_5 = Panel(entwine)
# gpt-4 Initial Response
# Sure, here's a script for creating a 3D
# parallelogram (parallelepiped) in Python using
# Rhino's Common API. This script can be used
# inside a Python script node in Grasshopper for
# Rhino 8 WIP:
panel_6 = Panel(entwine_2)  # disabled
