# Grasshopper definition 03__01_005_Rhombus.gh (Grasshopper 1.0.7)
# plug-ins: RhinoCodePluginGH

# ----
# Oscillation Algorithm
# The oscillation algorithm can be use to animate
# any geometry that is driven by a number sliders.
# Simply swap out the number sliders at the
# multiplication node in the oscillation script.
trigger = Trigger(Interval=10, TimerInterval=10, Target=data_recorder)  # disabled
panel = Panel("1")  # disabled
data_recorder = DataRecorder(panel, DataLimit=-10, RecordData=False)  # disabled
number_slider = Slider(288, range=0..1000)  # disabled
list_length = ListLength(List=data_recorder)  # disabled
division = Division(A=list_length, B=number_slider)  # disabled
cosine = Cosine(Value=division)  # disabled
sine = Sine(Value=division)  # disabled
# 2nd gpt-4 Text Prompt
# Great, now make the script much more complex model
# with NUMPY python library.
# Be sure to incorporate the previous code logic.
# ensure that this script produces 3d geometry as
# well for Data visualization purposes.
panel_2 = Panel([sine, cosine])  # disabled
multiplication = Multiplication(A=cosine)  # disabled
multiplication_2 = Multiplication(A=sine)  # disabled

# ----
# Visualize Mathematics
# with Python in Grasshopper
# at Wickerson Studios
# 003 AREA, VOLUME AND SURFACE AREA
# 3.1 AREA:
# 03_01_005_Rhombus
# BASIC SCRIPT
# gpt-4 Text Prompt
# Create a geometric 3D model with
# 
# MATHEMATICS
# AREA, VOULUME AND SURFACE AREA
# 
# to create a 3D model specifically about
# 
# Rhombus
# 
# 
# in python 3 code for the python 3 script
# node in grasshopper for Rhino8WIP using the
# Rhino Common API to create some geometry as well.
# 
# Output the parts of the model in different
# variable outputs in the python 3 node in
# grasshopper.
# PARAMETRIC SCRIPT
rhombus = Script()  # -> out, base_curve, top_curve; inputs a: list of Double, b: list of Double; disabled
# ---------- rhombus: Python ----------
import Rhino.Geometry as rg

def create_rhombus(base_pt, diagonal1, diagonal2):
    """Creates a rhombus in the XY plane with given diagonals."""
    half_diag1 = diagonal1 * 0.5
    half_diag2 = diagonal2 * 0.5

    p1 = rg.Point3d(base_pt.X + half_diag1, base_pt.Y, base_pt.Z)
    p2 = rg.Point3d(base_pt.X, base_pt.Y + half_diag2, base_pt.Z)
    p3 = rg.Point3d(base_pt.X - half_diag1, base_pt.Y, base_pt.Z)
    p4 = rg.Point3d(base_pt.X, base_pt.Y - half_diag2, base_pt.Z)

    return rg.Polyline([p1, p2, p3, p4, p1])

def create_rhombohedron(base_pt, diagonal1, diagonal2, height):
    """Creates a rhombohedron using given diagonals and height."""
    base_rhombus = create_rhombus(base_pt, diagonal1, diagonal2)
    top_rhombus = create_rhombus(rg.Point3d(base_pt.X, base_pt.Y, base_pt.Z + height), diagonal1, diagonal2)

    base_curve = base_rhombus.ToNurbsCurve()
    top_curve = top_rhombus.ToNurbsCurve()

    # Let's just return the curves first to see if they are generated correctly
    return base_curve, top_curve

base_point = rg.Point3d(0,0,0)
diagonal1 = 10
diagonal2 = 6
height = 8

base_curve, top_curve = create_rhombohedron(base_point, diagonal1, diagonal2, height)
# ---------- end rhombus ----------
rhombus_2 = Script()  # -> out, geometries; inputs a: list of Double, b: list of Double
# ---------- rhombus_2: Python ----------
import Rhino.Geometry as rg
import numpy as np

def create_rhombus(base_pt, diagonal1, diagonal2):
    half_diag1 = diagonal1 * 0.5
    half_diag2 = diagonal2 * 0.5

    p1 = rg.Point3d(base_pt.X + half_diag1, base_pt.Y, base_pt.Z)
    p2 = rg.Point3d(base_pt.X, base_pt.Y + half_diag2, base_pt.Z)
    p3 = rg.Point3d(base_pt.X - half_diag1, base_pt.Y, base_pt.Z)
    p4 = rg.Point3d(base_pt.X, base_pt.Y - half_diag2, base_pt.Z)

    return rg.Polyline([p1, p2, p3, p4, p1])

def create_rhombohedron(base_pt, diagonal1, diagonal2, height):
    base_rhombus = create_rhombus(base_pt, diagonal1, diagonal2)
    top_rhombus = create_rhombus(rg.Point3d(base_pt.X, base_pt.Y, base_pt.Z + height), diagonal1, diagonal2)

    base_curve = base_rhombus.ToNurbsCurve()
    top_curve = top_rhombus.ToNurbsCurve()

    # Lofting to create the rhombohedron geometry
    breps = rg.Brep.CreateFromLoft([base_curve, top_curve], rg.Point3d.Unset, rg.Point3d.Unset, rg.LoftType.Normal, False)
    
    return breps[0] if breps else None

# Create a grid of rhombohedrons
grid_size = 5  # Define how many rhombohedrons you want in one direction
spacing = 15  # Spacing between rhombohedrons

geometries = []

# Use numpy to generate random variations
heights = np.random.uniform(5, 10, (grid_size, grid_size))
diagonals1 = np.random.uniform(8, 12, (grid_size, grid_size))
diagonals2 = np.random.uniform(5, 7, (grid_size, grid_size))

for i in range(grid_size):
    for j in range(grid_size):
        base_point = rg.Point3d(i * spacing, j * spacing, 0)
        rhombohedron = create_rhombohedron(base_point, diagonals1[i, j], diagonals2[i, j], heights[i, j])
        if rhombohedron:
            geometries.append(rhombohedron)
# ---------- end rhombus_2 ----------
panel_3 = Panel(rhombus.out)  # disabled
geometry = Geometry(rhombus.top_curve)  # disabled
geometry_2 = Geometry(rhombus.base_curve)  # disabled
panel_4 = Panel(rhombus_2.out)
geometry_3 = Geometry(rhombus_2.geometries)
# gpt-4 Initial Response
loft = Loft(
    Curves=[geometry_2, geometry],
    Options={Adjust=False, Closed=False, LoftEnds=0, LoftSimp=0, LoftType=0, Rebuild=10, Refit=0.01})  # disabled
entwine = Entwine(Branch00=geometry_2, Branch01=geometry, FlattenInputs=True)  # disabled
entwine_2 = Entwine(Branch00=geometry_3, FlattenInputs=True)
# gpt-4 Initial Response
# Creating a 3D model for a rhombus can be a bit
# confusing since a rhombus is inherently a 2D
# shape. However, assuming you meant to create
#  a 3D structure derived from the shape of a
# rhombus (like a rhombohedron), I'll guide you
# through the process.
# 
# I'll break this down into two parts:
# 
# Generating the rhombus-derived 3D model
# using Python in Grasshopper.
# Computing area, volume, and surface area.
# 1. Generating the Rhombus-Derived 3D Model
# Here's a simple Python script to create a
# rhombohedron (a parallelepiped with rhombus
# faces) in Grasshopper for Rhino using the
# RhinoCommon API:
panel_5 = Panel(entwine)  # disabled
# To make the model more complex using the
# numpy library, we can create an array of
# rhombohedrons based on a defined spatial grid.
# This will allow us to visualize a collection of
# rhombohedrons, potentially with varying sizes
# and orientations.
panel_6 = Panel(entwine_2)
