# Grasshopper definition 03__01_006_Trapezium.gh (Grasshopper 1.0.7)
# plug-ins: RhinoCodePluginGH

# ----
# Oscillation Algorithm
# The oscillation algorithm can be use to animate
# any geometry that is driven by a number sliders.
# Simply swap out the number sliders at the
# multiplication node in the oscillation script.
trigger = Trigger(Interval=10, TimerInterval=10, Target=data_recorder)  # disabled
panel = Panel("1")  # disabled
data_recorder = DataRecorder(panel, DataLimit=-10, RecordData=False)  # disabled
number_slider = Slider(288, range=0..1000)  # disabled
list_length = ListLength(List=data_recorder)  # disabled
division = Division(A=list_length, B=number_slider)  # disabled
cosine = Cosine(Value=division)  # disabled
sine = Sine(Value=division)  # disabled
# 2nd gpt-4 Text Prompt
# Great, now make the script much more complex model
# with NUMPY python library.
# Be sure to incorporate the previous code logic.
# ensure that this script produces 3d geometry as
# well for Data visualization purposes.
panel_2 = Panel([sine, cosine])  # disabled
multiplication = Multiplication(A=cosine)  # disabled
multiplication_2 = Multiplication(A=sine)  # disabled

# ----
# Visualize Mathematics
# with Python in Grasshopper
# at Wickerson Studios
# 003 AREA, VOLUME AND SURFACE AREA
# 3.1 AREA:
# 03_01_006_Trapezium
# BASIC SCRIPT
# gpt-4 Text Prompt
# Create a geometric 3D model with
# 
# MATHEMATICS
# AREA, VOULUME AND SURFACE AREA
# 
# to create a 3D model specifically about
# 
# Trapezium
# 
# 
# in python 3 code for the python 3 script
# node in grasshopper for Rhino8WIP using the
# Rhino Common API to create some geometry as well.
# 
# Output the parts of the model in different
# variable outputs in the python 3 node in
# grasshopper.
# PARAMETRIC SCRIPT
trapezium = Script()  # -> out, a, b, c, d; inputs a: list of Double, b: list of Double
# ---------- trapezium: Python ----------
import Rhino
import Rhino.Geometry as rg
import math

def create_trapezoidal_prism(pt1, pt2, pt3, pt4, height):
    """
    Creates a trapezoidal prism given four base points and a height.
    
    Args:
        pt1, pt2, pt3, pt4: Base points of the trapezium.
        height: The height of the trapezoidal prism.
        
    Returns:
        The trapezoidal prism as a Brep.
    """
    # Create the base trapezium
    base_curve = rg.Polyline([pt1, pt2, pt3, pt4, pt1]).ToNurbsCurve()
    
    # Extrude the trapezium to create the prism
    direction = rg.Vector3d.ZAxis * height
    trapezoidal_prism = rg.Extrusion.Create(base_curve, height, True)
    
    return trapezoidal_prism.ToBrep()

# Define the four points of the trapezium
pt1 = rg.Point3d(0, 0, 0)
pt2 = rg.Point3d(10, 0, 0)
pt3 = rg.Point3d(8, 4, 0)
pt4 = rg.Point3d(2, 4, 0)

# Define the height of the prism
height = 5

# Create the prism
prism = create_trapezoidal_prism(pt1, pt2, pt3, pt4, height)

# Calculate the area and volume
area = prism.GetArea()
volume = prism.GetVolume()

# Get the surface areas of each face
surface_areas = [rg.AreaMassProperties.Compute(face).Area for face in prism.Faces]



# Output the results
a = prism
b = area
c = volume
d = surface_areas
# ---------- end trapezium ----------
trapezium_2 = Script()  # -> out, a, b, c, d; inputs a: list of Double, b: list of Double
# ---------- trapezium_2: Python ----------
import Rhino
import Rhino.Geometry as rg
import numpy as np

def create_trapezoidal_prism(pt1, pt2, pt3, pt4, height):
    """Creates a trapezoidal prism given four base points and a height."""
    base_curve = rg.Polyline([pt1, pt2, pt3, pt4, pt1]).ToNurbsCurve()
    direction = rg.Vector3d.ZAxis * height
    trapezoidal_prism = rg.Extrusion.Create(base_curve, height, True)
    return trapezoidal_prism.ToBrep()

# Create a grid of points
x_values = np.linspace(0, 100, 10)  # 10 points from 0 to 100
y_values = np.linspace(0, 100, 10)
base_points = np.array(np.meshgrid(x_values, y_values)).T.reshape(-1, 2)

prisms = []
for base_point in base_points:
    x, y = base_point
    
    # Random deviations
    dev1 = np.random.rand() * 5
    dev2 = np.random.rand() * 5
    dev3 = np.random.rand() * 5
    dev4 = np.random.rand() * 5
    
    pt1 = rg.Point3d(x, y, 0)
    pt2 = rg.Point3d(x + 10 + dev1, y, 0)
    pt3 = rg.Point3d(x + 8 + dev2, y + 4 + dev3, 0)
    pt4 = rg.Point3d(x + 2 + dev4, y + 4, 0)
    
    height = 5 + np.random.rand() * 10  # Random height between 5 and 15
    
    prism = create_trapezoidal_prism(pt1, pt2, pt3, pt4, height)
    if prism:  # Check if the prism creation was successful
        prisms.append(prism)

# Ensure all prisms are valid
prisms = [prism for prism in prisms if prism is not None]

# Compute area, volume, and surface areas for each prism
areas = [prism.GetArea() for prism in prisms]
volumes = [prism.GetVolume() for prism in prisms]
surface_areas_list = [[rg.AreaMassProperties.Compute(face).Area for face in prism.Faces] for prism in prisms]

# Output the results
a = prisms
b = areas
c = volumes
d = surface_areas_list
# ---------- end trapezium_2 ----------
geometry = Geometry(trapezium.a)
panel_3 = Panel(trapezium.out)
panel_4 = Panel(trapezium_2.out)
geometry_2 = Geometry(trapezium_2.a)
entwine = Entwine(Branch00=geometry, Branch01=trapezium.b, Branch02=trapezium.c, Branch03=trapezium.d, FlattenInputs=True)
# gpt-4 Initial Response
# Creating a geometric 3D model of a trapezium
# in Rhino's Grasshopper using the Rhino
# Common API can be a challenging task since a
# trapezium (or trapezoid in some regions) is
# typically a 2D shape. What we can create,
# however, is an extruded trapezium, effectively
# making it a trapezoidal prism.
panel_5 = Panel(entwine)
entwine_2 = Entwine(Branch00=geometry_2, Branch01=trapezium_2.b, Branch02=trapezium_2.c, Branch03=trapezium_2.d, FlattenInputs=True)
# gpt-4 Initial Response
# To make the model more complex using the
# numpy library, we can create an array of
# rhombohedrons based on a defined spatial grid.
# This will allow us to visualize a collection of
# rhombohedrons, potentially with varying sizes
# and orientations.
panel_6 = Panel(entwine_2)
