# Grasshopper definition 03__01_007_quadrilateral.gh (Grasshopper 1.0.7)
# plug-ins: RhinoCodePluginGH

# ----
# Oscillation Algorithm
# The oscillation algorithm can be use to animate
# any geometry that is driven by a number sliders.
# Simply swap out the number sliders at the
# multiplication node in the oscillation script.
trigger = Trigger(Interval=10, TimerInterval=10, Target=data_recorder)  # disabled
panel = Panel("1")  # disabled
data_recorder = DataRecorder(panel, DataLimit=-10, RecordData=False)  # disabled
number_slider = Slider(288, range=0..1000)  # disabled
list_length = ListLength(List=data_recorder)  # disabled
division = Division(A=list_length, B=number_slider)  # disabled
cosine = Cosine(Value=division)  # disabled
sine = Sine(Value=division)  # disabled
# PARAMETRIC SCRIPT
# 2nd gpt-4 Text Prompt
# Great, now make the script much more complex model
# with NUMPY python library. And use complex
# trogonometrical polynomials please.
# Be sure to incorporate the previous code logic.
# ensure that this script produces 3d geometry as
# well for Data visualization purposes.
panel_2 = Panel([sine, cosine])  # disabled
multiplication = Multiplication(A=cosine)  # disabled
multiplication_2 = Multiplication(A=sine)  # disabled

# ----
# 03_01_007_quadrilateral
# BASIC SCRIPT
# gpt-4 Text Prompt
# Create a geometric 3D model with
# 
# MATHEMATICS
# AREA, VOULUME AND SURFACE AREA
# 
# to create a 3D model specifically about
# 
# quadrilateral
# 
# 
# in python 3 code for the python 3 script
# node in grasshopper for Rhino8WIP using the
# Rhino Common API to create some geometry as well.
# 
# Output the parts of the model in different
# variable outputs in the python 3 node in
# grasshopper.
quadrilateral = Script()  # -> out, parallelepiped, b, c, d; inputs a: list of Double, b: list of Double; disabled
# ---------- quadrilateral: Python ----------
import Rhino.Geometry as rg
import math

def create_parallelepiped(base_pt, width, depth, height):
    # Calculate the 8 points of the parallelepiped
    ptA = base_pt
    ptB = rg.Point3d.Add(ptA, rg.Vector3d(width, 0, 0))
    ptC = rg.Point3d.Add(ptB, rg.Vector3d(0, depth, 0))
    ptD = rg.Point3d.Add(ptA, rg.Vector3d(0, depth, 0))
    ptE = rg.Point3d.Add(ptA, rg.Vector3d(0, 0, height))
    ptF = rg.Point3d.Add(ptE, rg.Vector3d(width, 0, 0))
    ptG = rg.Point3d.Add(ptF, rg.Vector3d(0, depth, 0))
    ptH = rg.Point3d.Add(ptE, rg.Vector3d(0, depth, 0))

    # Create the 6 faces of the parallelepiped
    face1 = rg.Brep.CreateFromCornerPoints(ptA, ptB, ptC, ptD, 0.01)
    face2 = rg.Brep.CreateFromCornerPoints(ptA, ptB, ptF, ptE, 0.01)
    face3 = rg.Brep.CreateFromCornerPoints(ptB, ptC, ptG, ptF, 0.01)
    face4 = rg.Brep.CreateFromCornerPoints(ptC, ptD, ptH, ptG, 0.01)
    face5 = rg.Brep.CreateFromCornerPoints(ptD, ptA, ptE, ptH, 0.01)
    face6 = rg.Brep.CreateFromCornerPoints(ptE, ptF, ptG, ptH, 0.01)

    # Join faces together
    breps = [face1, face2, face3, face4, face5, face6]
    joined_brep = rg.Brep.JoinBreps(breps, 0.01)[0]

    return joined_brep

def compute_volume_and_surface_area(brep):
    volume = brep.GetVolume()
    surface_area = brep.GetArea()

    return volume, surface_area

# Create parallelepiped
base_point = rg.Point3d(0, 0, 0)
width = 10
depth = 5
height = 7

parallelepiped = create_parallelepiped(base_point, width, depth, height)

# Compute volume and surface area
volume, surface_area = compute_volume_and_surface_area(parallelepiped)

# Output
print(f"Volume: {volume}")
print(f"Surface Area: {surface_area}")
# ---------- end quadrilateral ----------
# Visualize Mathematics
# with Python in Grasshopper
# at Wickerson Studios
# 003 AREA, VOLUME AND SURFACE AREA
# 3.1 AREA:
panel_3 = Panel(quadrilateral.out)  # disabled
geometry = Geometry(quadrilateral.parallelepiped)  # disabled
entwine = Entwine(Branch00=geometry, Branch01=quadrilateral.b, Branch02=quadrilateral.c, Branch03=quadrilateral.d, FlattenInputs=True)  # disabled
# gpt-4 Initial Response
# Creating a geometric 3D model of a trapezium
# in Rhino's Grasshopper using the Rhino
# Common API can be a challenging task since a
# trapezium (or trapezoid in some regions) is
# typically a 2D shape. What we can create,
# however, is an extruded trapezium, effectively
# making it a trapezoidal prism.
panel_4 = Panel(entwine)  # disabled
quadrilateral_2 = Script()  # -> out, a, b, c, d; inputs a: list of Double, b: list of Double
# ---------- quadrilateral_2: Python ----------
import Rhino.Geometry as rg
import numpy as np

def trigonometric_distortion(point, frequency, amplitude):
    # Apply trigonometric polynomial distortion
    x = point.X + amplitude * np.sin(frequency * point.X) * np.cos(frequency * point.Y)
    y = point.Y + amplitude * np.cos(frequency * point.X) * np.sin(frequency * point.Y)
    z = point.Z + amplitude * np.sin(frequency * point.Z)
    
    return rg.Point3d(x, y, z)

def create_complex_surface(ptA, ptB, ptC, ptD, frequency, amplitude):
    # Using numpy for smoother interpolation
    u_count = 10  # number of points in the U direction
    v_count = 10  # number of points in the V direction

    u = np.linspace(0, 1, u_count)
    v = np.linspace(0, 1, v_count)

    points = []

    for i, u_val in enumerate(u):
        u_row = []
        for j, v_val in enumerate(v):
            # Interpolate points based on u and v
            pt = (1 - u_val) * ((1 - v_val) * ptA + v_val * ptD) + u_val * ((1 - v_val) * ptB + v_val * ptC)
            distorted_pt = trigonometric_distortion(pt, frequency, amplitude)
            u_row.append(distorted_pt)
        points.append(u_row)

    return rg.NurbsSurface.CreateFromPoints(points, u_count, v_count, 3, 3)


def create_complex_parallelepiped(base_pt, width, depth, height, frequency, amplitude):
    # Basic points of the parallelepiped
    ptA = base_pt
    ptB = rg.Point3d.Add(ptA, rg.Vector3d(width, 0, 0))
    ptC = rg.Point3d.Add(ptB, rg.Vector3d(0, depth, 0))
    ptD = rg.Point3d.Add(ptA, rg.Vector3d(0, depth, 0))
    ptE = rg.Point3d.Add(ptA, rg.Vector3d(0, 0, height))
    ptF = rg.Point3d.Add(ptE, rg.Vector3d(width, 0, 0))
    ptG = rg.Point3d.Add(ptF, rg.Vector3d(0, depth, 0))
    ptH = rg.Point3d.Add(ptE, rg.Vector3d(0, depth, 0))

    # Create the 6 faces of the parallelepiped with distortion
    face1 = create_complex_surface(ptA, ptB, ptC, ptD, frequency, amplitude)
    face2 = create_complex_surface(ptA, ptB, ptF, ptE, frequency, amplitude)
    face3 = create_complex_surface(ptB, ptC, ptG, ptF, frequency, amplitude)
    face4 = create_complex_surface(ptC, ptD, ptH, ptG, frequency, amplitude)
    face5 = create_complex_surface(ptD, ptA, ptE, ptH, frequency, amplitude)
    face6 = create_complex_surface(ptE, ptF, ptG, ptH, frequency, amplitude)

    # Convert surfaces to brep for joining
    breps = [face1.ToBrep(), face2.ToBrep(), face3.ToBrep(), face4.ToBrep(), face5.ToBrep(), face6.ToBrep()]
    joined_brep = rg.Brep.JoinBreps(breps, 0.01)[0]

    return joined_brep

# Create complex parallelepiped
base_point = rg.Point3d(0, 0, 0)
width = 10
depth = 5
height = 7
frequency = 1
amplitude = 2  # control the level of distortion

complex_parallelepiped = create_complex_parallelepiped(base_point, width, depth, height, frequency, amplitude)

# Output for Grasshopper
a = complex_parallelepiped
# ---------- end quadrilateral_2 ----------
quadrilateral_3 = Script()  # -> out, complex_parallelepiped, b, c, d; inputs a: list of Double, b: list of Double; disabled
# ---------- quadrilateral_3: Python ----------
import Rhino.Geometry as rg
import numpy as np

def create_complex_parallelepiped(base_pt, width, depth, height, frequency):
    # Calculate the 8 points of the parallelepiped
    ptA = base_pt
    ptB = rg.Point3d.Add(ptA, rg.Vector3d(width, 0, 0))
    ptC = rg.Point3d.Add(ptB, rg.Vector3d(0, depth, 0))
    ptD = rg.Point3d.Add(ptA, rg.Vector3d(0, depth, 0))
    ptE = rg.Point3d.Add(ptA, rg.Vector3d(0, 0, height))
    ptF = rg.Point3d.Add(ptE, rg.Vector3d(width, 0, 0))
    ptG = rg.Point3d.Add(ptF, rg.Vector3d(0, depth, 0))
    ptH = rg.Point3d.Add(ptE, rg.Vector3d(0, depth, 0))
    
    # Distort these points using trigonometric functions
    ptA.Z += np.sin(frequency * ptA.X) * np.cos(frequency * ptA.Y) * 10
    ptB.Z += np.sin(frequency * ptB.X) * np.cos(frequency * ptB.Y) * 10
    ptC.Z += np.sin(frequency * ptC.X) * np.cos(frequency * ptC.Y) * 10
    ptD.Z += np.sin(frequency * ptD.X) * np.cos(frequency * ptD.Y) * 10
    ptE.Z += np.sin(frequency * ptE.X) * np.cos(frequency * ptE.Y) * 10
    ptF.Z += np.sin(frequency * ptF.X) * np.cos(frequency * ptF.Y) * 10
    ptG.Z += np.sin(frequency * ptG.X) * np.cos(frequency * ptG.Y) * 10
    ptH.Z += np.sin(frequency * ptH.X) * np.cos(frequency * ptH.Y) * 10

    # Create the 6 faces of the parallelepiped
    face1 = rg.Brep.CreateFromCornerPoints(ptA, ptB, ptC, ptD, 0.01)
    face2 = rg.Brep.CreateFromCornerPoints(ptA, ptB, ptF, ptE, 0.01)
    face3 = rg.Brep.CreateFromCornerPoints(ptB, ptC, ptG, ptF, 0.01)
    face4 = rg.Brep.CreateFromCornerPoints(ptC, ptD, ptH, ptG, 0.01)
    face5 = rg.Brep.CreateFromCornerPoints(ptD, ptA, ptE, ptH, 0.01)
    face6 = rg.Brep.CreateFromCornerPoints(ptE, ptF, ptG, ptH, 0.01)

    # Join faces together
    breps = [face1, face2, face3, face4, face5, face6]
    joined_brep = rg.Brep.JoinBreps(breps, 0.01)[0]

    return joined_brep

def compute_volume_and_surface_area(brep):
    volume = brep.GetVolume()
    surface_area = brep.GetArea()

    return volume, surface_area

# Create complex parallelepiped
base_point = rg.Point3d(0, 0, 0)
width = 10
depth = 5
height = 7
frequency = 1

complex_parallelepiped = create_complex_parallelepiped(base_point, width, depth, height, frequency)

# Compute volume and surface area
volume, surface_area = compute_volume_and_surface_area(complex_parallelepiped)

# Output
print(f"Volume: {volume}")
print(f"Surface Area: {surface_area}")
# ---------- end quadrilateral_3 ----------
panel_5 = Panel(quadrilateral_2.out)
# gpt-4 Initial Response
# To make the model more complex using the
# numpy library, we can create an array of
# rhombohedrons based on a defined spatial grid.
# This will allow us to visualize a collection of
# rhombohedrons, potentially with varying sizes
# and orientations.
panel_6 = Panel(quadrilateral_3.out)  # disabled
geometry_2 = Geometry(quadrilateral_2.a)
geometry_3 = Geometry(quadrilateral_3.complex_parallelepiped)  # disabled
entwine_2 = Entwine(
    Branch00=geometry_2,
    Branch01=quadrilateral_2.b,
    Branch02=quadrilateral_2.c,
    Branch03=quadrilateral_2.d,
    FlattenInputs=True)
entwine_3 = Entwine(
    Branch00=geometry_3,
    Branch01=quadrilateral_3.b,
    Branch02=quadrilateral_3.c,
    Branch03=quadrilateral_3.d,
    FlattenInputs=True)  # disabled
panel_7 = Panel(entwine_2)
panel_8 = Panel(entwine_3)  # disabled
