# Grasshopper definition 04__01_001_Polynomial_formulaquadratic.gh (Grasshopper 1.0.7)
# plug-ins: RhinoCodePluginGH

# ----
# Oscillation Algorithm
# The oscillation algorithm can be use to animate
# any geometry that is driven by a number sliders.
# Simply swap out the number sliders at the
# multiplication node in the oscillation script.
trigger = Trigger(Interval=10, TimerInterval=10, Target=data_recorder)  # disabled
panel = Panel("1")  # disabled
data_recorder = DataRecorder(panel, DataLimit=-10, RecordData=False)  # disabled
number_slider = Slider(288, range=0..1000)  # disabled
list_length = ListLength(List=data_recorder)  # disabled
division = Division(A=list_length, B=number_slider)  # disabled
cosine = Cosine(Value=division)  # disabled
sine = Sine(Value=division)  # disabled
# 2nd gpt-4 Text Prompt
# Great, now make the script much more complex model
# with NUMPY python library. And use complex
# trogonometrical polynomials please.
# Be sure to incorporate the previous code logic.
# ensure that this script produces 3d geometry as
# well for Data visualization purposes.
panel_2 = Panel([sine, cosine])  # disabled
multiplication = Multiplication(A=cosine)  # disabled
multiplication_2 = Multiplication(A=sine)  # disabled

# ----
# BASIC SCRIPT
# PARAMETRIC SCRIPT
# Y = a * X**2 + b * np.sin(c * X) + d * np.cos(e * X) + f
number_slider_2 = Slider(0.73, range=-3..3)
# 004 ALGEBRA & ARITHMETIC
# 4.1 Polynomial Formula
# 04_01_001_quadratic
# gpt-4 Text Prompt
# Create a geometric 3D model with
# 
# MATHEMATICS
# ALGEBRA AND ARITHMETIC
# POLYNOMIAL FORMULA
# 
# to create a 3D model specifically about
# 
# quadratic
# 
# 
# in python 3 code for the python 3 script
# node in grasshopper for Rhino8WIP using the
# Rhino Common API to create some geometry as well.
# 
# Output the parts of the model in different
# variable outputs in the python 3 node in
# grasshopper.
quadratic = Script()  # -> out, A, b, c, d; inputs a: list of Double, b: list of Double; disabled
# ---------- quadratic: Python ----------
import Rhino
import math
import rhinoscriptsyntax as rs

def quadratic_surface(a, b, c, domain):
    """Generate points based on the quadratic formula: y = ax^2 + bx + c over a certain domain."""
    points = []

    for x in range(domain[0], domain[1] + 1):
        for z in range(domain[2], domain[3] + 1):
            y = a*x**2 + b*x + c
            points.append(Rhino.Geometry.Point3d(x, y, z))
    return points

# Parameters:
a = 1  # These are just sample coefficients. Adjust as needed.
b = 0
c = 0

domain = [-10, 10, -10, 10]  # [x_start, x_end, z_start, z_end]

# Get the points from the quadratic equation
points = quadratic_surface(a, b, c, domain)

# Here, we're outputting just the points, but you could further create surfaces or meshes based on these points.
# Output
A = points
# ---------- end quadratic ----------
# Visualize Mathematics
# with Python in Grasshopper
# at Wickerson Studios
panel_3 = Panel(quadratic.out)  # disabled
geometry = Geometry(quadratic.A)  # disabled
quadratic_2 = Script(
    a=number_slider_2,
    b=Slider(2.21, range=-3..3),
    c=Slider(1.94, range=-3..3),
    d=Slider(2.87, range=-3..3),
    e=Slider(3, range=-3..3),
    f=Slider(1.02, range=-3..3))  # -> out, A, B, c, d; inputs a: list of Double, b: list of Double, c: Double, d: Double, e: Double, f: Double
# ---------- quadratic_2: Python ----------
import Rhino
import rhinoscriptsyntax as rs
import numpy as np

def complex_quadratic_surface(a, b, c, d, e, f, domain, resolution=1):
    """Generate points based on the complex quadratic formula combined with trigonometry."""
    points = []

    x_vals = np.arange(domain[0], domain[1] + resolution, resolution)
    z_vals = np.arange(domain[2], domain[3] + resolution, resolution)
    X, Z = np.meshgrid(x_vals, z_vals)

    Y = a * X**2 + b * np.sin(c * X) + d * np.cos(e * X) + f

    for i in range(X.shape[0]):
        for j in range(X.shape[1]):
            points.append(Rhino.Geometry.Point3d(X[i, j], Y[i, j], Z[i, j]))

    return points

# Parameters:
"""
a = 1  
b = 1
c = 3
d = 2
e = 2
f = 0
"""

domain = [-10, 10, -10, 10]  # [x_start, x_end, z_start, z_end]

# Get the points from the complex quadratic function
points = complex_quadratic_surface(a, b, c, d, e, f, domain, 0.5)

# Generate a 3D mesh for better visualization
vertices = points
faces = []

for i in range(int((domain[1] - domain[0]) / 0.5) - 1):
    for j in range(int((domain[3] - domain[2]) / 0.5) - 1):
        pt1 = i + j * (int((domain[1] - domain[0]) / 0.5))
        pt2 = (i + 1) + j * (int((domain[1] - domain[0]) / 0.5))
        pt3 = i + (j + 1) * (int((domain[1] - domain[0]) / 0.5))
        pt4 = (i + 1) + (j + 1) * (int((domain[1] - domain[0]) / 0.5))

        faces.append([pt1, pt2, pt3])
        faces.append([pt2, pt4, pt3])

mesh = Rhino.Geometry.Mesh()

for pt in vertices:
    mesh.Vertices.Add(pt)

for face in faces:
    mesh.Faces.AddFace(face[0], face[1], face[2])

# Output
A = points
B = mesh
# ---------- end quadratic_2 ----------
entwine = Entwine(Branch00=geometry, Branch01=quadratic.b, Branch02=quadratic.c, Branch03=quadratic.d, FlattenInputs=True)  # disabled
panel_4 = Panel(quadratic_2.out)
geometry_2 = Geometry(quadratic_2.A)
geometry_3 = Geometry(quadratic_2.B)
# gpt-4 Initial Response
# To create a 3D model based on a quadratic
# equation using Python in a Grasshopper node
# for Rhino8WIP, you'll need to implement the
# formula and utilize the Rhino Common API. The
# following script will help you model a parabola in
# 3D space using the quadratic formula:
panel_5 = Panel(entwine)  # disabled
entwine_2 = Entwine(Branch00=geometry_2, Branch01=geometry_3, Branch02=quadratic_2.c, Branch03=quadratic_2.d, FlattenInputs=True)
# gpt-4 Initial Response
# Sure! Let's use the numpy library to create a
# more complex trigonometric polynomial and
# visualize it in 3D space. Here's an example that combines a quadratic formula with trigonometric
#  functions:
panel_6 = Panel(entwine_2)
