# Grasshopper definition 04__01_002_cubic.gh (Grasshopper 1.0.7)
# plug-ins: RhinoCodePluginGH

# ----
# Oscillation Algorithm
# The oscillation algorithm can be use to animate
# any geometry that is driven by a number sliders.
# Simply swap out the number sliders at the
# multiplication node in the oscillation script.
trigger = Trigger(Interval=10, TimerInterval=10, Target=data_recorder)  # disabled
panel = Panel("1")  # disabled
data_recorder = DataRecorder(panel, DataLimit=-10, RecordData=False)  # disabled
number_slider = Slider(288, range=0..1000)  # disabled
list_length = ListLength(List=data_recorder)  # disabled
division = Division(A=list_length, B=number_slider)  # disabled
cosine = Cosine(Value=division)  # disabled
sine = Sine(Value=division)  # disabled
# 2nd gpt-4 Text Prompt
panel_2 = Panel([sine, cosine])  # disabled
multiplication = Multiplication(A=cosine)  # disabled
multiplication_2 = Multiplication(A=sine)  # disabled

# ----
# PARAMETRIC SCRIPT
# Z = a*X**3 + b*X**2*Y + c*X*Y**2 + d*Y**3
# Great, now make the script much more complex model
# with NUMPY python library.
# 
# Be sure to incorporate the previous code logic.
# ensure that this script produces 3d geometry as
# well for Data visualization purposes.
number_slider_2 = Slider(-1, range=-1..1)
# 004 ALGEBRA & ARITHMETIC
# 4.1 Polynomial Formula
# 04_01_002_cubic
# BASIC SCRIPT
# gpt-4 Text Prompt
# Create a geometric 3D model with
# 
# MATHEMATICS
# ALGEBRA AND ARITHMETIC
# POLYNOMIAL FORMULA
# 
# to create a 3D model specifically about
# 
# cubic
# 
# 
# in python 3 code for the python 3 script
# node in grasshopper for Rhino8WIP using the
# Rhino Common API to create some geometry as well.
# 
# Output the parts of the model in different
# variable outputs in the python 3 node in
# grasshopper.
cubic = Script()  # -> out, curve, b, c, d; inputs a: list of Double, b: list of Double
# ---------- cubic: Python ----------
import Rhino
import rhinoscriptsyntax as rs
import math

def cubic_curve(a, b, c, d, domain):
    """Compute cubic curve points."""
    points = []
    for x in domain:
        y = a*x**3 + b*x**2 + c*x + d
        z = 0  # for 3D, we'll just use z=0, but you can modify this to achieve a 3D curve
        points.append(Rhino.Geometry.Point3d(x, y, z))
    return points

def main(a, b, c, d, domain_start=-1, domain_end=3, steps=1000):
    """Generate the cubic curve and output it."""
    
    # Generate the domain values for the curve
    domain = [domain_start + i * (domain_end - domain_start)/steps for i in range(steps)]
    
    # Get the cubic curve points
    points = cubic_curve(a, b, c, d, domain)
    
    # Create a polyline from the points
    pline = Rhino.Geometry.Polyline(points)
    
    return pline

# Coefficients for the cubic curve
a, b, c, d = 1, -3, 2, 1

# Compute the curve
curve = main(a, b, c, d)

# Output the curve
print(curve)
# ---------- end cubic ----------
# Visualize Mathematics
# with Python in Grasshopper
# at Wickerson Studios
panel_3 = Panel(cubic.out)
geometry = Geometry(cubic.curve)
cubic_2 = Script(a=number_slider_2, b=Slider(1, range=-1..1), c=Slider(0.19, range=-1..1), d=Slider(-0.04, range=-1..1))  # -> out, surface, c, d; inputs a: list of Double, b: list of Double, c: Double, d: Double
# ---------- cubic_2: Python ----------
import Rhino
import rhinoscriptsyntax as rs
import numpy as np

def cubic_surface(a, b, c, d, x_domain, y_domain):
    """Compute the 3D points for a cubic surface."""
    x = np.linspace(x_domain[0], x_domain[1], 100)  # adjust resolution as needed
    y = np.linspace(y_domain[0], y_domain[1], 100)
    X, Y = np.meshgrid(x, y)
    
    Z = a*X**3 + b*X**2*Y + c*X*Y**2 + d*Y**3
    
    return X, Y, Z

def main(a, b, c, d, x_domain=(-10, 10), y_domain=(-10, 10)):
    """Generate and return the cubic surface."""
    X, Y, Z = cubic_surface(a, b, c, d, x_domain, y_domain)
    
    points = []
    for i in range(X.shape[0]):
        for j in range(X.shape[1]):
            pt = Rhino.Geometry.Point3d(X[i, j], Y[i, j], Z[i, j])
            points.append(pt)
            
    # Convert the points into a grid of 3D faces for visualization
    faces = []
    for i in range(X.shape[0]-1):
        for j in range(X.shape[1]-1):
            face = Rhino.Geometry.MeshFace(i + j*X.shape[0], 
                                           (i+1) + j*X.shape[0], 
                                           (i+1) + (j+1)*X.shape[0], 
                                           i + (j+1)*X.shape[0])
            faces.append(face)
            
    mesh = Rhino.Geometry.Mesh()
    mesh.Vertices.AddVertices(points)
    mesh.Faces.AddFaces(faces)
    
    return mesh

# Coefficients for the cubic surface
#a, b, c, d = 1, -3, 2, 1

# Compute the surface
surface = main(a, b, c, d)

# Output the surface
print(surface)
# ---------- end cubic_2 ----------
entwine = Entwine(Branch00=geometry, Branch01=cubic.b, Branch02=cubic.c, Branch03=cubic.d, FlattenInputs=True)
panel_4 = Panel(cubic_2.out)
geometry_2 = Geometry(cubic_2.surface)
# gpt-4 Initial Response
# Certainly! Below is a simple Python script to
# create a 3D cubic curve in Grasshopper for
# Rhino 8 using the Rhino Common API. This
# script, when plugged into a Python script node in
#  Grasshopper, will allow you to visualize a cubic
# curve and manipulate its coefficients.
# 
# This cubic is in the form
# y = a*x**3 + b*x**2 + c*x + d
panel_5 = Panel(entwine)
entwine_2 = Entwine(Branch00=geometry_2, Branch02=cubic_2.c, Branch03=cubic_2.d, FlattenInputs=True)
# gpt-4 Initial Response
# Alright, I'll enhance the code to produce a more
# complex 3D model using NumPy and the logic
# we discussed. We'll visualize the 3D surface of a
#  cubic function
# Z = a*X**3 + b*X**2*Y + c*X*Y**2 + d*Y**3
panel_6 = Panel(entwine_2)
