# Grasshopper definition 04__03_001_Babylonian_Identity.gh (Grasshopper 1.0.7)
# plug-ins: RhinoCodePluginGH

# ----
# Oscillation Algorithm
# The oscillation algorithm can be use to animate
# any geometry that is driven by a number sliders.
# Simply swap out the number sliders at the
# multiplication node in the oscillation script.
trigger = Trigger(Interval=10, TimerInterval=10, Target=data_recorder)  # disabled
panel = Panel("1")  # disabled
data_recorder = DataRecorder(panel, DataLimit=-10, RecordData=False)  # disabled
number_slider = Slider(288, range=0..1000)  # disabled
list_length = ListLength(List=data_recorder)  # disabled
division = Division(A=list_length, B=number_slider)  # disabled
cosine = Cosine(Value=division)  # disabled
sine = Sine(Value=division)  # disabled
# 2nd gpt-4 Text Prompt
# Great, now make the script much more complex model
# with NUMPY python library.
# 
# Be sure to incorporate the previous code logic.
# ensure that this script produces 3d geometry as
# well for Data visualization purposes.
panel_2 = Panel([sine, cosine])  # disabled
multiplication = Multiplication(A=cosine)  # disabled
multiplication_2 = Multiplication(A=sine)  # disabled

# ----
# Visualize Mathematics
# with Python in Grasshopper
# at Wickerson Studios
# 004 ALGEBRA & ARITHMETIC
# 4.3 Algebraic Expansion
# 04_03_001_Pabylonian_Identity
# BASIC SCRIPT
# gpt-4 Text Prompt
# Create a geometric 3D model with
# 
# MATHEMATICS
# ALGEBRA AND ARITHMETIC
# ALGEBRAIC EXPANSION
# 
# to create a 3D model specifically about
# 
# Babylonian Identity
# 
# 
# in python 3 code for the python 3 script
# node in grasshopper for Rhino8WIP using the
# Rhino Common API to create some geometry as well.
# 
# Output the parts of the model in different
# variable outputs in the python 3 node in
# grasshopper.
# PARAMETRIC SCRIPT
babylonian_identity = Script()  # -> out, a_output, b_output, c_output, d_output, left_top_output, left_bottom_output; inputs a: list of Double, b: list of Double
# ---------- babylonian_identity: Python ----------
import Rhino
import math

# Input values (for now, just using example numbers)
a = 1
b = 2
c = 3
d = 4

# Calculate areas
a2 = a*a
b2 = b*b
c2 = c*c
d2 = d*d
left_top = (a*c - b*d)*(a*c - b*d)
left_bottom = (a*d + b*c)*(a*d + b*c)

# Left squares for a^2 and b^2
left_top_plane = Rhino.Geometry.Plane.WorldXY
left_top_plane.Translate(Rhino.Geometry.Vector3d(0,0,a2/2))  # move it up by half its side for visual clarity
left_bottom_plane = Rhino.Geometry.Plane.WorldXY
left_bottom_plane.Translate(Rhino.Geometry.Vector3d(0,0,-b2/2))  # move it down by half its side for visual clarity
left_top_square = Rhino.Geometry.PlaneSurface(left_top_plane, Rhino.Geometry.Interval(0, math.sqrt(a2)), Rhino.Geometry.Interval(0, math.sqrt(a2)))
left_bottom_square = Rhino.Geometry.PlaneSurface(left_bottom_plane, Rhino.Geometry.Interval(0, math.sqrt(b2)), Rhino.Geometry.Interval(0, math.sqrt(b2)))

# Middle squares for c^2 and d^2
middle_top_plane = Rhino.Geometry.Plane.WorldXY
middle_top_plane.Translate(Rhino.Geometry.Vector3d(2*math.sqrt(a2),0,c2/2))  # move it right and up for visual clarity
middle_bottom_plane = Rhino.Geometry.Plane.WorldXY
middle_bottom_plane.Translate(Rhino.Geometry.Vector3d(2*math.sqrt(a2),0,-d2/2))  # move it right and down for visual clarity
middle_top_square = Rhino.Geometry.PlaneSurface(middle_top_plane, Rhino.Geometry.Interval(0, math.sqrt(c2)), Rhino.Geometry.Interval(0, math.sqrt(c2)))
middle_bottom_square = Rhino.Geometry.PlaneSurface(middle_bottom_plane, Rhino.Geometry.Interval(0, math.sqrt(d2)), Rhino.Geometry.Interval(0, math.sqrt(d2)))

# Right squares for (ac-bd)^2 and (ad+bc)^2
right_top_plane = Rhino.Geometry.Plane.WorldXY
right_top_plane.Translate(Rhino.Geometry.Vector3d(4*math.sqrt(a2),0,left_top/2))  # move it right and up for visual clarity
right_bottom_plane = Rhino.Geometry.Plane.WorldXY
right_bottom_plane.Translate(Rhino.Geometry.Vector3d(4*math.sqrt(a2),0,-left_bottom/2))  # move it right and down for visual clarity
right_top_square = Rhino.Geometry.PlaneSurface(right_top_plane, Rhino.Geometry.Interval(0, math.sqrt(left_top)), Rhino.Geometry.Interval(0, math.sqrt(left_top)))
right_bottom_square = Rhino.Geometry.PlaneSurface(right_bottom_plane, Rhino.Geometry.Interval(0, math.sqrt(left_bottom)), Rhino.Geometry.Interval(0, math.sqrt(left_bottom)))

# Output
a_output = left_top_square
b_output = left_bottom_square
c_output = middle_top_square
d_output = middle_bottom_square
left_top_output = right_top_square
left_bottom_output = right_bottom_square
# ---------- end babylonian_identity ----------
babylonian_identity_2 = Script()  # -> out, a_output, b_output, c_output, d_output, left_top_output, left_bottom_output; inputs a: list of Double, b: list of Double; disabled
# ---------- babylonian_identity_2: Python ----------
import Rhino
import math
import numpy as np

# Generate a random matrix of values for a, b, c, and d
size = 10  # Define the size of your matrix/sequence
values = np.random.randint(1, 5, size=(size, 4))  # Random values between 1 and 5 for simplicity

# Placeholder lists for our outputs
all_a_squares = []
all_b_squares = []
all_c_squares = []
all_d_squares = []
all_left_top_squares = []
all_left_bottom_squares = []

for idx, (a, b, c, d) in enumerate(values):
    # Calculate areas using Babylonian Identity
    a2 = a*a
    b2 = b*b
    c2 = c*c
    d2 = d*d
    left_top = (a*c - b*d)*(a*c - b*d)
    left_bottom = (a*d + b*c)*(a*d + b*c)

    # For visualization, we'll offset each square in the grid based on its index
    offset = idx * 6  # Space between each set of squares

    # a^2 square
    a_plane = Rhino.Geometry.Plane.WorldXY
    a_plane.Translate(Rhino.Geometry.Vector3d(offset, 0, 0))
    a_square = Rhino.Geometry.PlaneSurface(a_plane, Rhino.Geometry.Interval(0, math.sqrt(a2)), Rhino.Geometry.Interval(0, math.sqrt(a2)))
    all_a_squares.append(a_square)

    # b^2 square
    b_plane = Rhino.Geometry.Plane.WorldXY
    b_plane.Translate(Rhino.Geometry.Vector3d(offset, math.sqrt(a2) + 2, 0))
    b_square = Rhino.Geometry.PlaneSurface(b_plane, Rhino.Geometry.Interval(0, math.sqrt(b2)), Rhino.Geometry.Interval(0, math.sqrt(b2)))
    all_b_squares.append(b_square)

    # c^2 square
    c_plane = Rhino.Geometry.Plane.WorldXY
    c_plane.Translate(Rhino.Geometry.Vector3d(offset + math.sqrt(a2) + 2, 0, 0))
    c_square = Rhino.Geometry.PlaneSurface(c_plane, Rhino.Geometry.Interval(0, math.sqrt(c2)), Rhino.Geometry.Interval(0, math.sqrt(c2)))
    all_c_squares.append(c_square)

    # d^2 square
    d_plane = Rhino.Geometry.Plane.WorldXY
    d_plane.Translate(Rhino.Geometry.Vector3d(offset + math.sqrt(a2) + 2, math.sqrt(c2) + 2, 0))
    d_square = Rhino.Geometry.PlaneSurface(d_plane, Rhino.Geometry.Interval(0, math.sqrt(d2)), Rhino.Geometry.Interval(0, math.sqrt(d2)))
    all_d_squares.append(d_square)

    # left_top square
    lt_plane = Rhino.Geometry.Plane.WorldXY
    lt_plane.Translate(Rhino.Geometry.Vector3d(offset + 2*(math.sqrt(a2) + 2), 0, 0))
    lt_square = Rhino.Geometry.PlaneSurface(lt_plane, Rhino.Geometry.Interval(0, math.sqrt(left_top)), Rhino.Geometry.Interval(0, math.sqrt(left_top)))
    all_left_top_squares.append(lt_square)

    # left_bottom square
    lb_plane = Rhino.Geometry.Plane.WorldXY
    lb_plane.Translate(Rhino.Geometry.Vector3d(offset + 2*(math.sqrt(a2) + 2), math.sqrt(left_top) + 2, 0))
    lb_square = Rhino.Geometry.PlaneSurface(lb_plane, Rhino.Geometry.Interval(0, math.sqrt(left_bottom)), Rhino.Geometry.Interval(0, math.sqrt(left_bottom)))
    all_left_bottom_squares.append(lb_square)

# Outputs
a_output = all_a_squares
b_output = all_b_squares
c_output = all_c_squares
d_output = all_d_squares
left_top_output = all_left_top_squares
left_bottom_output = all_left_bottom_squares
# ---------- end babylonian_identity_2 ----------
panel_3 = Panel(babylonian_identity.out)
geometry = Geometry(babylonian_identity.a_output)
geometry_2 = Geometry(babylonian_identity.b_output)
geometry_3 = Geometry(babylonian_identity.c_output)
geometry_4 = Geometry(babylonian_identity.d_output)
geometry_5 = Geometry(babylonian_identity.left_top_output)
# gpt-4 Initial Response
geometry_6 = Geometry(babylonian_identity.left_bottom_output)
panel_4 = Panel(babylonian_identity_2.out)  # disabled
babylonian_identity_3 = Script(grid_size=Slider(3, range=0..10))  # -> out, output; inputs grid_size: Int32
# ---------- babylonian_identity_3: Python ----------
import Rhino
import math
import numpy as np

# Generate a random 3D grid of values for a, b, c, and d
#grid_size = 3  # Define the size of your 3D grid (e.g., 3x3x3)
values = np.random.randint(1, 5, size=(grid_size, grid_size, grid_size, 4))  # 3D grid of random values

all_geometries = []

for i in range(grid_size):
    for j in range(grid_size):
        for k in range(grid_size):
            a, b, c, d = values[i, j, k]

            # Babylonian Identity calculations
            a2 = int(a*a)
            b2 = int(b*b)
            c2 = int(c*c)
            d2 = int(d*d)
            left_top = int((a*c - b*d)*(a*c - b*d))
            left_bottom = int((a*d + b*c)*(a*d + b*c))

            # Create 3D boxes at each grid position based on the Babylonian Identity
            # The height of each box represents its value
            origin = Rhino.Geometry.Point3d(i * 15, j * 15, k * 15)  # Separation between boxes for visualization
            
            a_box = Rhino.Geometry.Box(Rhino.Geometry.Plane(origin, Rhino.Geometry.Vector3d.ZAxis), Rhino.Geometry.Interval(0, math.sqrt(a2)), Rhino.Geometry.Interval(0, 1), Rhino.Geometry.Interval(0, a2))
            b_box = Rhino.Geometry.Box(Rhino.Geometry.Plane(origin + Rhino.Geometry.Vector3d(0,2,0), Rhino.Geometry.Vector3d.ZAxis), Rhino.Geometry.Interval(0, math.sqrt(b2)), Rhino.Geometry.Interval(0, 1), Rhino.Geometry.Interval(0, b2))
            c_box = Rhino.Geometry.Box(Rhino.Geometry.Plane(origin + Rhino.Geometry.Vector3d(0,4,0), Rhino.Geometry.Vector3d.ZAxis), Rhino.Geometry.Interval(0, math.sqrt(c2)), Rhino.Geometry.Interval(0, 1), Rhino.Geometry.Interval(0, c2))
            d_box = Rhino.Geometry.Box(Rhino.Geometry.Plane(origin + Rhino.Geometry.Vector3d(0,6,0), Rhino.Geometry.Vector3d.ZAxis), Rhino.Geometry.Interval(0, math.sqrt(d2)), Rhino.Geometry.Interval(0, 1), Rhino.Geometry.Interval(0, d2))
            left_top_box = Rhino.Geometry.Box(Rhino.Geometry.Plane(origin + Rhino.Geometry.Vector3d(0,8,0), Rhino.Geometry.Vector3d.ZAxis), Rhino.Geometry.Interval(0, math.sqrt(left_top)), Rhino.Geometry.Interval(0, 1), Rhino.Geometry.Interval(0, left_top))
            left_bottom_box = Rhino.Geometry.Box(Rhino.Geometry.Plane(origin + Rhino.Geometry.Vector3d(0,10,0), Rhino.Geometry.Vector3d.ZAxis), Rhino.Geometry.Interval(0, math.sqrt(left_bottom)), Rhino.Geometry.Interval(0, 1), Rhino.Geometry.Interval(0, left_bottom))

            all_geometries.extend([a_box, b_box, c_box, d_box, left_top_box, left_bottom_box])

# Output all the geometries
output = all_geometries
# ---------- end babylonian_identity_3 ----------
entwine = Entwine(
    Branch00=geometry,
    Branch01=geometry_2,
    Branch02=geometry_3,
    Branch03=geometry_4,
    Branch04=geometry_5,
    Branch05=geometry_6,
    FlattenInputs=True)
geometry_7 = Geometry(babylonian_identity_2.a_output)  # disabled
geometry_8 = Geometry(babylonian_identity_2.b_output)  # disabled
geometry_9 = Geometry(babylonian_identity_2.c_output)  # disabled
geometry_10 = Geometry(babylonian_identity_2.d_output)  # disabled
geometry_11 = Geometry(babylonian_identity_2.left_top_output)  # disabled
geometry_12 = Geometry(babylonian_identity_2.left_bottom_output)  # disabled
entwine_2 = Entwine(
    Branch00=geometry_7,
    Branch01=geometry_8,
    Branch02=geometry_9,
    Branch03=geometry_10,
    Branch04=geometry_11,
    Branch05=geometry_12,
    FlattenInputs=True)  # disabled
# gpt-4 Initial Response
# The Babylonian Identity refers to the algebraic identity:
# left_top = (a*c - b*d)*(a*c - b*d)
# left_bottom = (a*d + b*c)*(a*d + b*c)
panel_5 = Panel(entwine)
panel_6 = Panel(babylonian_identity_3.out)
geometry_13 = Geometry(babylonian_identity_3.output)
# Alright, we can use numpy for more complex
# mathematical operations. To represent the
# Babylonian Identity in 3D geometry with a more
# complex model, we might consider visualizing a
# sequence or matrix of numbers and their
# resulting geometric representations.
# 
# In the example below, I'll demonstrate how to
# generate random sequences of numbers
# 
# a,b,c,d, compute their associated areas using
# the Babylonian Identity, and create a 3D grid of
# squares in Rhino to visualize these
# computations.
panel_7 = Panel(entwine_2)  # disabled
entwine_3 = Entwine(Branch00=geometry_13, FlattenInputs=True)
panel_8 = Panel(entwine_3)
