# Grasshopper definition 04__03_003_Binomial_Theorem.gh (Grasshopper 1.0.7)
# plug-ins: RhinoCodePluginGH

# ----
# 004 ALGEBRA & ARITHMETIC
# 4.3 Algebraic Expansion
# 04_03_003_Binomial_Theorem
# BASIC SCRIPT
# gpt-4 Text Prompt
# Create a geometric 3D model with
# 
# MATHEMATICS
# ALGEBRA AND ARITHMETIC
# ALGEBRAIC EXPANSION
# 
# to create a 3D model specifically about
# 
# Binomial Theorem
# 
# 
# in python 3 code for the python 3 script
# node in grasshopper for Rhino8WIP using the
# Rhino Common API to create some geometry as well.
# 
# Output the parts of the model in different
# variable outputs in the python 3 node in
# grasshopper.
# PARAMETRIC SCRIPT
# 2nd gpt-4 Text Prompt
# Great, now make the script much more complex model
# with NUMPY python library.
# 
# Be sure to incorporate the previous code logic.
# ensure that this script produces 3d geometry as
# well for Data visualization purposes.
number_slider = Slider(10, range=0..10)  # disabled
number_slider_2 = Slider(2.31, range=0..3)
# Visualize Mathematics
# with Python in Grasshopper
# at Wickerson Studios
binomial_theorem = Script(n=number_slider)  # -> out, n, geometry_output; inputs n: Int32, b: list of Double; disabled
# ---------- binomial_theorem: Python ----------
import Rhino.Geometry as rg
import math

def binomial_coefficient(n, k):
    """Compute binomial coefficient."""
    return math.factorial(n) / (math.factorial(k) * math.factorial(n - k))

def binomial_expansion(n):
    """Return the terms and coefficients of (a + b)^n expansion."""
    terms = []
    for k in range(n + 1):
        coeff = binomial_coefficient(n, k)
        a_power = n - k
        b_power = k
        terms.append((coeff, a_power, b_power))
    return terms

def main(n):
    terms = binomial_expansion(n)
    spheres = []
    
    max_coeff = max([term[0] for term in terms])
    for term in terms:
        coeff, a_power, b_power = term
        point = rg.Point3d(a_power, b_power, 0)
        radius = coeff / max_coeff
        sphere = rg.Sphere(point, radius)
        spheres.append(sphere)
        
    return spheres

# Change the value of n for the binomial expansion.
#n = 3

# Executing main function
spheres_output = main(n)

# Explicitly casting each sphere to Geometry before output
geometry_output = [rg.Brep.CreateFromSurface(rg.NurbsSurface.CreateFromSphere(s)) for s in spheres_output]
# ---------- end binomial_theorem ----------
binomial_theorem_2 = Script(n=Slider(3, range=0..10), spread=number_slider_2)  # -> out, n, geometry_output; inputs n: Int32, spread: Double
# ---------- binomial_theorem_2: Python ----------
import Rhino.Geometry as rg
import math
import numpy as np

def binomial_coefficient(n, k):
    """Compute binomial coefficient."""
    return math.factorial(n) / (math.factorial(k) * math.factorial(n - k))

def binomial_expansion(n):
    """Return the terms and coefficients of (a + b)^n expansion."""
    terms = []
    for k in range(n + 1):
        coeff = binomial_coefficient(n, k)
        a_power = n - k
        b_power = k
        terms.append((coeff, a_power, b_power))
    return terms

def generate_point_cloud(point, magnitude, spread=1.0):
    """Generate a cloud of random points around a given point."""
    coords = np.random.randn(magnitude, 3) * spread + np.array(point)
    return [rg.Point3d(coord[0], coord[1], coord[2]) for coord in coords]

def main(n, spread=1.0):
    terms = binomial_expansion(n)
    meshes = []
    
    max_coeff = max([term[0] for term in terms])
    for term in terms:
        coeff, a_power, b_power = term
        point = (a_power, b_power, 0)
        magnitude = int(coeff * 10)  # scaling factor for visualization
        points = generate_point_cloud(point, magnitude, spread)

        # Create a mesh sphere for each point in the point cloud
        for pt in points:
            radius = coeff / max_coeff  # Scale the sphere radii based on coefficients
            sphere = rg.Sphere(pt, radius)
            mesh = rg.Mesh.CreateFromSphere(sphere, 6, 6)  # Low res sphere for better performance
            meshes.append(mesh)

    return meshes

# Change the value of n for the binomial expansion.
#n = 3
#spread = 1.0  # This determines how spread out the points are. Adjust as necessary.

# Executing main function
geometry_output = main(n, spread)
# ---------- end binomial_theorem_2 ----------
geometry = Geometry(binomial_theorem.geometry_output)  # disabled
panel = Panel(binomial_theorem.out)  # disabled
geometry_2 = Geometry(binomial_theorem_2.geometry_output)
panel_2 = Panel(binomial_theorem_2.out)
# gpt-4 Initial Response
# Sure! Let's introduce numpy into the equation to
#  achieve a more complex model. I'll make use of
# numpy to generate a field of points around each
#  term of the binomial expansion. The magnitude
# of the field (number of points) will be determined
#  by the coefficient, and then I'll generate a
# Voronoi 3D structure around each term based
# on these points for a more intricate visualization.
# 
# Here's how it's done:
# 
# Use numpy to generate a cloud of random
# points around the term's position.
# Use the coefficient as a magnitude for the
# number of points.
# Use Rhino's Voronoi function to generate the
# Voronoi cells around each term.
entwine = Entwine(Branch00=binomial_theorem.n, Branch01=geometry, FlattenInputs=True)  # disabled
entwine_2 = Entwine(Branch00=binomial_theorem_2.n, Branch01=geometry_2, FlattenInputs=True)
panel_3 = Panel(entwine_2)
# gpt-4 Initial Response
# Certainly! The Binomial Theorem,
# (a+b) ^n
#  , allows us to expand a binomial expression that
#  has been raised to an arbitrary power. This expansion can be represented as:
# def binomial_coefficient(n, k):
#     """Compute binomial coefficient."""
#     return math.factorial(n) / (math.factorial(k) * math.factorial(n - k))
panel_4 = Panel(entwine)  # disabled

# ----
# Oscillation Algorithm
# The oscillation algorithm can be use to animate
# any geometry that is driven by a number sliders.
# Simply swap out the number sliders at the
# multiplication node in the oscillation script.
trigger = Trigger(Interval=10, TimerInterval=10, Target=data_recorder)  # disabled
panel_5 = Panel("1")  # disabled
data_recorder = DataRecorder(panel_5, DataLimit=-10, RecordData=False)  # disabled
number_slider_3 = Slider(81, range=0..1000)  # disabled
list_length = ListLength(List=data_recorder)  # disabled
division = Division(A=list_length, B=number_slider_3)  # disabled
cosine = Cosine(Value=division)  # disabled
sine = Sine(Value=division)  # disabled
panel_6 = Panel([sine, cosine])  # disabled
multiplication = Multiplication(A=cosine, B=number_slider_2)  # disabled
absolute = Absolute(Value=multiplication)  # disabled
multiplication_2 = Multiplication(A=sine)  # disabled
